# Dynamo graph how_to.dyn (Dynamo 2.12.1.8246)

# group: Create IfcDoc structure (init internal IfcDatabase)
ifc_document_specs = dyn2ifc.IfcDoc.ifc_document_specs()
ifc_units = dyn2ifc.IfcDoc.ifc_units()
ifcDoc = dyn2ifc.IfcDoc.IfcDoc(ifc_ModelView=ifc_document_specs.Ifc4Reference, length_units=ifc_units.Metre)

# group: Generate some points and their attributes
create_points = Python()  # CPython3
# ---------- create_points.python (16 lines) ----------
# Загрузить стандартную библиотеку Python и библиотеку DesignScript
import sys
import clr
import random
clr.AddReference('ProtoGeometry')
from Autodesk.DesignScript.Geometry import Point

points_list = []
points_attrs = []
for x in range(0,50,10):
    for y in range (0,50,10):
        point_new = Point.ByCoordinates(x,y,random.randrange(0,20,2))
        points_list.append(point_new)
        points_attrs.append([["Point_info", str(x) + "_" +  str(y) + "_" +  str(point_new.Z)]])
# Назначьте вывод переменной OUT.
OUT = points_list, points_attrs
# ----------------------------------------
code_block = CodeBlock(a=create_points) { a; geometry = a[0]; attributes = a[1]; }

# group: Create Geometry representation of Ifc-elements
radius = CodeBlock { 3; }
as_IfcShapeRepresentation = dyn2ifc.IfcGeometry.as_IfcShapeRepresentation.as_IfcShapeRepresentation(ifc_document=ifcDoc, point=code_block.geometry, radius=radius)
get_IfcFaceBasedSurfaceModel = dyn2ifc.IfcGeometry.as_IfcShapeRepresentation.Get_IfcFaceBasedSurfaceModel(as_IfcShapeRepresentation=as_IfcShapeRepresentation)

# group: Create an IfcGroup for grouping elements in IFC file
name_of_group = CodeBlock { "storey_0.0"; 0.0; }
ifcGrouping = dyn2ifc.IfcGrouping.IfcGrouping(ifc_document=ifcDoc, name=name_of_group.out0, elevation=name_of_group.out1)

# group: Convert geometry and group-info to IfcBuildingElementProxy element
to_IfcBuildingElementProxy = dyn2ifc.IfcObject.to_IfcBuildingElementProxy(ifc_document=ifcDoc, ifcShapeRepresentation=get_IfcFaceBasedSurfaceModel, group=ifcGrouping)

# group: Create IfcProperties (as one-property in List)
ifcProperties = dyn2ifc.IfcProperties.IfcProperties(ifc_document=ifcDoc, properties=code_block.attributes)

# group: Merge info about object's properties, naming, materials (all optional-data values)
code_block_2 = CodeBlock { null; "sphere"; }
ifcObject = dyn2ifc.IfcObject.IfcObject(ifc_element=to_IfcBuildingElementProxy, GlobalId=code_block_2.out0, name=code_block_2.out1, material=code_block_2.out0, description=code_block_2.out0, properties=ifcProperties)

# group: Saving IFC file to that directory with path
code_block_3 = CodeBlock { "E:\\Temp"; "ifc_test"; true; }
only_for_order = List.Create(item0=ifcObject)
saveIfc = dyn2ifc.IfcDoc.SaveIfc(ifcDoc=ifcDoc, directory_path=code_block_3.out0, file_name=code_block_3.out1, Overwrite=code_block_3.out2, wait_pbjects_list=only_for_order)
