# Dynamo graph test1.dyn (Dynamo 2.12.1.8246)

# group: Ifc file initialization
ifc_document_specs = dyn2ifc.IfcFile.IfcDoc.ifc_document_specs()
ifc_units = dyn2ifc.IfcFile.IfcDoc.ifc_units()
initIfcDatabase = dyn2ifc.IfcFile.IfcDoc.InitIfcDatabase(ifc_type=ifc_document_specs.Ifc2x3Coordination, units=ifc_units.Metre)

# group: simple generator points
points = Python(IN[0]=initIfcDatabase)  # IronPython2
# ---------- points.python (15 lines) ----------
# Загрузить стандартную библиотеку Python и библиотеку DesignScript
import sys
import clr
clr.AddReference('ProtoGeometry')
from Autodesk.DesignScript.Geometry import Point as _pnt

out_points = list()
out_properties = list()
for i in range (0,50,5):
	for j in range (0,50,5):
		out_points.append(_pnt.ByCoordinates(i,j,0))
		test_property = list()
		test_property.append(["point_name", "point_" + str(i) + "_" + str(j)])
		out_properties.append(test_property)
OUT = out_points,out_properties
# ----------------------------------------

code_block = CodeBlock(a=points) { a[0]; a[1]; "zero_level"; 0; 1; }

# group: Creation a IfcGroup -- for grouping data in Level (IfcBuildingStorey) recommended
ifcGrouping = dyn2ifc.IfcGrouping.IfcGrouping(name=code_block.out2, elevation=code_block.out3)
group = dyn2ifc.IfcGrouping.group(ifcGrouping=ifcGrouping)

# group: Convert geometry representation
as_IfcShapeRepresentation = dyn2ifc.IfcGeometry.as_IfcShapeRepresentation.as_IfcShapeRepresentation(point=code_block.out0, radius=code_block.out4)
get_IfcFaceBasedSurfaceModel = dyn2ifc.IfcGeometry.as_IfcShapeRepresentation.Get_IfcFaceBasedSurfaceModel(as_IfcShapeRepresentation=as_IfcShapeRepresentation)
to_IfcBuildingElementProxy = dyn2ifc.IfcObject.to_IfcBuildingElementProxy(ifcShapeRepresentation=get_IfcFaceBasedSurfaceModel, group=group)

# group: Color (ifcMaterial)
color = CodeBlock { [0, 255, 0]; 1; "green_color"; }
ifcMaterialSet = dyn2ifc.IfcMaterialSet.IfcMaterialSet(color_data=color.out0, material_name=color.out2)
material = dyn2ifc.IfcMaterialSet.material(ifcMaterialSet=ifcMaterialSet)

# group: Create properties (optional)
ifcProperties = dyn2ifc.IfcProperties.IfcProperties(properties=code_block.out1)
properties = dyn2ifc.IfcProperties.properties(ifcProperties=ifcProperties)

# group: Create IfcBuildingElementProxy by elements
guid = dyn2ifc.IfcObject.guid()
obkects_IFC_names = CodeBlock { "point"; "point descr"; }
ifcObject = dyn2ifc.IfcObject.IfcObject(ifc_element=to_IfcBuildingElementProxy, GlobalId=guid, name=obkects_IFC_names.out0, material=material, description=obkects_IFC_names.out1, properties=properties)
code_block_2 = CodeBlock(a=ifcObject) { a; b = 3; }

# group: Save IFC
code_block_3 = CodeBlock { true; "E:\\Temp"; "dyn_ifc1"; }
saveIfc = dyn2ifc.IfcFile.IfcDoc.SaveIfc(directory_path=code_block_3.out1, file_name=code_block_3.out2, Overwrite=code_block_3.out0, aux_order=code_block_2.b)
